# Grasshopper definition discrete curvatures.gh (Grasshopper 0.9.76)

number_slider = Slider(26, range=0..40)

panel = Panel("8")
crv = Curve(<curve referenced from the Rhino model>)
explode = Explode(Curve=crv, Recursive=True)  # -> Segments, Vertices
cp = ControlPoints(Curve=crv)  # -> Points, Weights, Knots
intcrv = Interpolate(Vertices=cp.Points, Degree=3, Periodic=False, KnotStyle=1)  # -> Curve, Length, Domain
end = EndPoints(Curve=explode.Segments)  # -> Start, End
vec2pt = Vector2Pt(PointA=end.Start, PointB=end.End, Unitize=False)  # -> Vector, Length
line = LineSDL(Start=end.End, Direction=vec2pt.Vector, Length=12)

line_2 = Line(Line((258.75, 182, 0), (278.75, 182, 0)))
end_2 = EndPoints(Curve=line_2)  # -> Start, End
domain = Domain(Domain(0, 180))
xy = XYPlane(Origin=end_2.End)
range = Range(Domain=domain, Steps=number_slider)
cull_i = CullIndex(List=range, Indices=0, Wrap=True)
hframe = HorizontalFrame(Curve=reparameterize(line_2), Parameter=0.5)
rotate = Rotate(Geometry=line_2, Angle=degrees(cull_i), Plane=xy)  # -> Geometry, Transform
deplane = DeconstructPlane(Plane=hframe)  # -> Origin, XAxis, YAxis, ZAxis
end_3 = EndPoints(Curve=rotate.Geometry)  # -> Start, End
line_3 = LineSDL(Start=deplane.Origin, Direction=deplane.YAxis, Length=100)
circle = CircleCNR(Center=[end_3.Start, end_2.Start, end_2.End], Normal=Vector(0, 0, 1), Radius=0.5)
hframe_2 = HorizontalFrame(Curve=reparameterize(rotate.Geometry), Parameter=0.5)
deplane_2 = DeconstructPlane(Plane=hframe_2)  # -> Origin, XAxis, YAxis, ZAxis
line_4 = LineSDL(Start=deplane_2.Origin, Direction=deplane_2.YAxis, Length=100)
llx = LineLine(Line1=line_3, Line2=line_4)  # -> ParamA, ParamB, PointA, PointB
dist = Distance(PointA=llx.PointA, PointB=deplane.Origin)
cir = Circle(Plane=llx.PointA, Radius=dist)

# ----
# vertex-based curvature
line_5 = Line(Line((258.75, 257, 0), (278.75, 257, 0)))
end_4 = EndPoints(Curve=line_5)  # -> Start, End
# edge-based curvature
domain_2 = Domain(Domain(0, 180))
xy_2 = XYPlane(Origin=end_4.End)
range_2 = Range(Domain=domain_2, Steps=number_slider)
cull_i_2 = CullIndex(List=range_2, Indices=0, Wrap=True)
rotate_2 = Rotate(Geometry=line_5, Angle=degrees(cull_i_2), Plane=xy_2)  # -> Geometry, Transform
end_5 = EndPoints(Curve=rotate_2.Geometry)  # -> Start, End
circle_2 = CircleCNR(Center=[end_5.Start, end_4.Start, end_4.End], Normal=Vector(0, 0, 1), Radius=0.4)
circle_3 = Circle3Pt(PointA=end_4.Start, PointB=end_4.End, PointC=end_5.Start)  # -> Circle, Plane, Radius

crv_cp = CurveClosestPoint(Point=cp.Points, Curve=intcrv.Curve)  # -> Point, Parameter, Distance
frame = CurveFrame(Curve=intcrv.Curve, Parameter=crv_cp.Parameter)
deplane_3 = DeconstructPlane(Plane=frame)  # -> Origin, XAxis, YAxis, ZAxis
cir_2 = Circle(Plane=cp.Points, Radius=0.7)
line_6 = LineSDL(Start=crv_cp.Point, Direction=deplane_3.XAxis, Length=6)
trim = TrimWithRegion(Curve=circle_3.Circle, Region=<geometry referenced from the Rhino model>)  # -> Inside, Outside
crv_2 = Curve(trim.Inside)
trim_2 = TrimWithRegion(Curve=cir, Region=<geometry referenced from the Rhino model>)  # -> Inside, Outside
crv_3 = Curve(trim_2.Inside)
