# Grasshopper definition section deformations.gh (Grasshopper 0.9.76)
# plug-ins: TMarsupilami

sqgrid = Square(Plane=PlaneXY(322.5, 62, 0), Size=2, ExtentX=5, ExtentY=15)  # -> Cells, Points
boundary = BoundarySurfaces(Edges=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)
srf = Surface(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)
sprop = SectionProperties(TheSection=srf)  # -> F, A, I1, I2, I3, I
boundary_2 = BoundarySurfaces(Edges=<geometry referenced from the Rhino model>)
pt = Point(<point referenced from the Rhino model>)
divide = DivideCurve(Curve=<geometry referenced from the Rhino model>, Count=Slider(15, range=0..200), Kinks=False)  # -> Points, Tangents, Parameters
matrix = DisplayMatrix(sprop.I, Digits=0)
pt_2 = ConstructPoint(XCoordinate=0, YCoordinate=0, ZCoordinate=0)
srf_2 = Surface(boundary)
sdivide = DivideSurface(Surface=boundary_2, UCount=Slider(20, range=0..200), VCount=Slider(30, range=0..200))  # -> simplify(Points), simplify(Normals), simplify(Parameters)
planar = IsPlanar(Surface=srf_2, Interior=True)  # -> Planar, Plane
pt_3 = Point(<point referenced from the Rhino model>)
pt_4 = ConstructPoint(XCoordinate=0, YCoordinate=0, ZCoordinate=0)
vec2pt = Vector2Pt(PointA=pt_3, PointB=pt_2, Unitize=False)  # -> Vector, Length
# Computes the section principal axes and corresponding tensor of inertia. The strong axis is always the first. The weak axis is the second. The perpendicular to the section planar surface is the third axis.
principal_axes = CSharpScript(srf=srf_2, Reference="C:\Users\Admin\AppData\Roaming\Grasshopper\Libraries\alglibnet2.dll")  # -> out, P, S, I1, I2, I3, I; inputs srf: Surface
# ---------- principal_axes: C# ----------
    double tolerance = 1e-8;

    // Make sure the surface is planar
    Plane surfacePlane;
    if(srf.TryGetPlane(out surfacePlane, tolerance))
    {
      Print("Plane : " + surfacePlane.XAxis);
      Print("Plane : " + surfacePlane.YAxis);
      Print("Plane : " + surfacePlane.ZAxis);

      // Position the surface plane at the centroid
      var amp = AreaMassProperties.Compute(srf);
      var centroid = amp.Centroid;
      var a = centroid.X;
      var b = centroid.Y;
      var c = centroid.Z;
      surfacePlane.Origin = centroid;

      // Get section area
      var A = amp.Area;

      // Compute the inertia tensor in the world coordinate system ROxyz = {O,ex,ey,ez}
      var IO_xx = amp.WorldCoordinatesMomentsOfInertia.X;
      var IO_yy = amp.WorldCoordinatesMomentsOfInertia.Y;
      var IO_zz = amp.WorldCoordinatesMomentsOfInertia.Z;
      var IO_xy = -amp.WorldCoordinatesProductMoments.X;
      var IO_xz = -amp.WorldCoordinatesProductMoments.Z;
      var IO_yz = -amp.WorldCoordinatesProductMoments.Y;

      // Compute the inertia tensor in the world coordinate system RGxyz = {G,ex,ey,ez} translated to the centroid (G)
      // this requires Huygens theorem
      var IG_xx = IO_xx - A * (b * b + c * c);
      var IG_yy = IO_yy - A * (a * a + c * c);
      var IG_zz = IO_zz - A * (a * a + b * b);
      var IG_xy = IO_xy + A * a * b;
      var IG_xz = IO_xz + A * a * c;
      var IG_yz = IO_yz + A * b * c;

      var IGxyz = new Matrix(3, 3);
      IGxyz[0, 0] = IG_xx;    IGxyz[0, 1] = IG_xy;    IGxyz[0, 2] = IG_xz;
      IGxyz[1, 0] = IG_xy;    IGxyz[1, 1] = IG_yy;    IGxyz[1, 2] = IG_yz;
      IGxyz[2, 0] = IG_xz;    IGxyz[2, 1] = IG_yz;    IGxyz[2, 2] = IG_zz;

      // #####################
      // first change of basis
      // #####################

      // We express the inertia tensor in the surfacePlane coordinate system RGijk = {G, ei, ej, ek}.
      // We know that ek is normal to the surface and that ei and ej lie on the surface.
      // Thus the tensor components : IG_ik = IG_jk = 0 and IG_kk will be the polar inertia and third eigen value

      // We call P1 the transformation matrix from RGijk to RGxyz, that is the columns of P1 are {ei,ej,ek}.
      // We call TP1 the transpose of P1.
      var ei = surfacePlane.XAxis;
      var ej = surfacePlane.YAxis;
      var ek = surfacePlane.ZAxis;
      var P1 = new Matrix(3, 3);
      P1[0, 0] = ei.X;       P1[0, 1] = ej.X;       P1[0, 2] = ek.X;
      P1[1, 0] = ei.Y;       P1[1, 1] = ej.Y;       P1[1, 2] = ek.Y;
      P1[2, 0] = ei.Z;       P1[2, 1] = ej.Z;       P1[2, 2] = ek.Z;


      Print("Plane : " + ei);
      Print("Plane : " + ej);
      Print("Plane : " + ek);

      // The Inertia tensor in RGijk is now : IGijk = TP1 x IG_RGxyz x P1
      var TP1 = P1.Duplicate(); TP1.Transpose();
      var IGijk = TP1 * IGxyz * P1;
      var IG_ii = IGijk[0, 0];
      var IG_jj = IGijk[1, 1];
      var IG_kk = IGijk[2, 2];
      var IG_ij = IGijk[0, 1];

      // #######################
      // second change of basis
      // #######################

      // based on : http://scipp.ucsc.edu/~haber/ph116A/diag2x2_11.pdf

      // We know the third eigen value and corresponding eigen vector for IGxyz :
      var e3 = ek;
      var IG_33 = IG_kk;

      // We have now a simpler 2x2 diagonalisation problem to solve, that is a rotation in the plane perpendicular to e3 = ek
      // The remaining eigen values satisfy the following equation : l^2 - (IG_ii + IG_jj)l + (IG_ii*IG_jj) - IG_ij^2 = 0
      var D = Math.Sqrt((IG_ii - IG_jj) * (IG_ii - IG_jj) + 4 * IG_ij * IG_ij);
      var IG_11 = 0.5 * ((IG_ii + IG_jj) + D); // strong axis
      var IG_22 = 0.5 * ((IG_ii + IG_jj) - D); // weak axis (IG_22 < IG_11)

      Print("IG_11 = " + IG_11);
      Print("IG_22 = " + IG_22);
      Print("IG_33 = " + IG_33);

      Print("v1" + (2 * IG_ij * ei));
      Print("v2 = " + (IG_jj - IG_ii + D) * ej);


      // The eigen vector e1 associated with eigen value IG_11 is given by :
      var e1 = 2 * IG_ij * ei + (IG_jj - IG_ii + D) * ej;
      e1.Unitize();

      // The eigen vector e2 associated with eigen value IG_22 is given by :
      var e2 = 2 * IG_ij * ei + (IG_jj - IG_ii - D) * ej;
      e2.Unitize();

      // Thus, the sectioPlane si given by {G, e1, e2, e3 = e1 x e2}
      var sectionPlane = new Plane(centroid, e1, Vector3d.CrossProduct(e3, e1));


      Print("e1 = " + e1);
      Print("e2 = " + e2);
      Print("e3 = " + e3);

      // We call P2 the transformation matrix from RG123 to RGxyz, that is the columns of P2 are {e1,e2,e3}.
      // We call TP2 the transpose of P2.
      var P2 = new Matrix(3, 3);
      P2[0, 0] = e1.X; P2[0, 1] = e2.X; P2[0, 2] = e3.X;
      P2[1, 0] = e1.Y; P2[1, 1] = e2.Y; P2[1, 2] = e3.Y;
      P2[2, 0] = e1.Z; P2[2, 1] = e2.Z; P2[2, 2] = e3.Z;
      var TP2 = P2.Duplicate(); TP2.Transpose();
      var IG123 = TP2 * IGxyz * P2;

      // the previous computation is not necessary has we already know that IG123 = diag(IG_11, IG_22, IG_33)
      // but it's a way to check the results
      //var IG123 = new Matrix(3, 3);
      //IG123[0, 0] = IG_11;
      //IG123[1, 1] = IG_22;
      //IG123[2, 2] = IG_33;

      P = sectionPlane;
      S = A;
      I1 = IG_11;
      I2 = IG_22;
      I3 = IG_33;
      I = IG123;
      Iijk = IGijk;
    }
    else
    {
      Print("Non Planar Surface");
    }
# ---------- end principal_axes ----------
pt_5 = Point(sdivide.Points)
pt_6 = Point(<point referenced from the Rhino model>)
xy = XYPlane(Origin=Point(0, 0, 0))
vec2pt_2 = Vector2Pt(PointA=pt_6, PointB=pt_4, Unitize=False)  # -> Vector, Length
pt_7 = Point(divide.Points)
move = Move(Geometry=pt_5, Motion=vec2pt.Vector)  # -> Geometry, Transform
# Align the section to OXY plane and use the built-in component for area moments about world axis. Check the results.
orient = Orient(Geometry=srf_2, Source=principal_axes.P, Target=xy)  # -> Geometry, Transform
sprop_2 = SectionProperties(TheSection=orient.Geometry)  # -> F, A, I1, I2, I3, I
matrix_2 = DisplayMatrix(principal_axes.I, Digits=0)
move_2 = Move(Geometry=pt_7, Motion=vec2pt_2.Vector)  # -> Geometry, Transform
pdecon = Deconstruct(Point=move.Geometry)  # -> XComponent, YComponent, ZComponent
amoments = AreaMoments(Geometry=orient.Geometry)  # -> Area, Centroid, Inertia, InertiaError, Secondary, SecondaryError, Gyration
pdecon_2 = Deconstruct(Point=move_2.Geometry)  # -> XComponent, YComponent, ZComponent
x2 = Number(expr("-x", pdecon.XComponent))
x1 = Number(pdecon.YComponent)
U = CSharpScript(
    X1=x1,
    X2=x2,
    e=Slider(0.1, range=0..0.5),
    w1=Slider(0.12, range=-0.5..0.5),
    w2=Slider(0.06, range=-0.5..0.5),
    w3=Slider(0, range=0..0.5))  # -> out, u; inputs X1: Double, X2: Double, e: Double, w1: Double, w2: Double, w3: Double
# ---------- U: C# ----------
    var E = 20e9;
    var G = 5e9;
    var v = 0.3;

    var _w1 = 0;
    var _w2 = 0;
    var _w3 = 0;

    var u1 = -v * e * X1 - v * (w1 - _w1) * X1 * X2 + 0.5 * v * (w2 - _w2) * (X1 * X1 - X2 * X2);
    var u2 = -v * e * X2 + v * (w2 - _w2) * X1 * X2 + 0.5 * v * (w1 - _w1) * (X1 * X1 - X2 * X2);
    var u3 = (w3 - _w3) * phi_rect(X1, X2);

    u = new Vector3d(u1, u2, u3);
# ---------- U: C# additional code ----------
  public double phi(double X1, double X2)
  {
    return X1 * X2;
  }

  public double phi_rect(double X1, double X2)
  {
    double a = 5;
    double b = 10;
    int N = 10;

    double phi = X1 * X2;

    double sum = 0;
    for (int n = 0; n < N; n++)
    {
      var kn = (2 * n + 1) * Math.PI / (2 * a);
      sum += Math.Pow(-1, n) * Math.Sin(kn * X1) * Math.Sinh(kn * X2) / (Math.Pow(2 * n + 1, 3) * Math.Cosh(kn * b));
    }

    phi -= 32 * a * a / Math.Pow(Math.PI, 3) * sum;

    return phi;
  }
# ---------- end U ----------
panel = Panel(U.u)
area_moment_in_xyz = Panel(amoments.Inertia)
x1_2 = Number(pdecon_2.YComponent)
U_2 = CSharpScript(
    X1=x1_2,
    X2=0,
    e=Slider(0.1, range=0..0.5),
    w1=Slider(0.12, range=-0.5..0.5),
    w2=Slider(0.06, range=-0.5..0.5),
    w3=Slider(0.16, range=0..0.5))  # -> out, u; inputs X1: Double, X2: Double, e: Double, w1: Double, w2: Double, w3: Double; same code as U
panel_2 = Panel(U_2.u)
pdecon_3 = Deconstruct(Point=U.u)  # -> XComponent, YComponent, ZComponent

pdecon_4 = Deconstruct(Point=amoments.Inertia)  # -> XComponent, YComponent, ZComponent
subtraction = Subtraction(A=principal_axes.I1, B=pdecon_4.XComponent)
subtraction_2 = Subtraction(A=principal_axes.I2, B=pdecon_4.YComponent)
subtraction_3 = Subtraction(A=principal_axes.I3, B=pdecon_4.ZComponent)
panel_3 = Panel(subtraction)
panel_4 = Panel(subtraction_2)
panel_5 = Panel(subtraction_3)

pdecon_5 = Deconstruct(Point=U_2.u)  # -> XComponent, YComponent, ZComponent
pt_8 = ConstructPoint(XCoordinate=expr("-x", pdecon_3.YComponent), YCoordinate=pdecon_3.XComponent, ZCoordinate=pdecon_3.ZComponent)
pt_9 = ConstructPoint(XCoordinate=expr("-x", pdecon_5.YComponent), YCoordinate=pdecon_5.XComponent, ZCoordinate=pdecon_5.ZComponent)
move_3 = Move(Geometry=pt_5, Motion=pt_8)  # -> simplify(Geometry), Transform
path_mapper = PathMapper(move_3.Geometry, source="{A}(i)", target="{i}(A)")
move_4 = Move(Geometry=pt_7, Motion=pt_9)  # -> simplify(Geometry), Transform
group = Group(Objects=flatten(move_3.Geometry))
path_mapper_2 = PathMapper(move_4.Geometry, source="{A}(i)", target="{i}(A)")
group_2 = Group(Objects=flatten(move_4.Geometry))
intcrv = Interpolate(Vertices=path_mapper, Degree=3, Periodic=False, KnotStyle=1)  # -> simplify(flatten(Curve)), Length, Domain
intcrv_2 = Interpolate(Vertices=move_3.Geometry, Degree=3, Periodic=False, KnotStyle=1)  # -> simplify(flatten(Curve)), Length, Domain
item = ListItem(List=intcrv.Curve, Index=Slider(8, range=0..100), Wrap=True)
intcrv_3 = Interpolate(Vertices=path_mapper_2, Degree=3, Periodic=False, KnotStyle=1)  # -> simplify(flatten(Curve)), Length, Domain
intcrv_4 = Interpolate(Vertices=move_4.Geometry, Degree=3, Periodic=False, KnotStyle=1)  # -> simplify(flatten(Curve)), Length, Domain
item_2 = ListItem(List=intcrv_3.Curve, Index=Slider(8, range=0..100), Wrap=True)
group_3 = Group(Objects=[intcrv_2.Curve, intcrv.Curve])
group_4 = Group(Objects=[intcrv_4.Curve, intcrv_3.Curve])
